# Grasshopper definition txt_writer.gh (Grasshopper 1.0.4)

python = GhPythonScript(Path="C:\Users\YU\Desktop\otf", Name="test", Filetype="txt", Write=Button())  # -> out, a; inputs Text: list
# ---------- python: Python ----------
__author__ = "YU"

import rhinoscriptsyntax as rs
import os
import Grasshopper as gh

if Write:
    filePath = os.path.join(Path,Name + "."+Filetype)
    fileWrite = open(filePath,"w")
    for line in Text:
        fileWrite.write(line + "\n")
    fileWrite.close()
    
else:
    msg = "HaHAHAHAHAHAHHAHA"
    ghenv.Component.AddRuntimeMessage(gh.Kernel.GH_RuntimeMessageLevel.Warning, msg)
# ---------- end python ----------
